# Dynamo graph 01_Export Solids to IFC_2.0.dyn (Dynamo 2.0.2.6826)

# group: Inputs
civilApplication = CivilConnection.CivilApplication.CivilApplication()
document = StringInput("Bridge2018_Solids.dwg")  # graph input

# group: Get Document
getDocumentByName = CivilConnection.CivilApplication.GetDocumentByName(civilApplication=civilApplication, name=document)

# group: Create IFC
exportIFC = CivilConnection.RevitUtils.ExportIFC(civilDocument=getDocumentByName)
