# Dynamo graph 13.2_Pipes.dyn (Dynamo 2.0.2.6826)

# group: Inputs
element_types = ElementTypes(index=238)  # graph input
all_elements_of_type = ElementsOfType(element_type=element_types)
code_block = CodeBlock(x=all_elements_of_type) { a = x.Name == "Fire Protection Wet" ? x : null; List.RemoveIfNot(a, "Revit.Elements.Element")[0]; }
code_block_2 = CodeBlock(a=code_block.out1) { a.Name; }
element_types_2 = ElementTypes(index=236)  # graph input
all_elements_of_type_2 = ElementsOfType(element_type=element_types_2)
code_block_3 = CodeBlock(a=all_elements_of_type_2) { a[0]; }
levels = Levels(index=0)  # graph input
civilApplication = CivilConnection.CivilApplication.CivilApplication()
document = StringInput("Bridge2018.dwg")  # graph input
corridor = StringInput("Bridge")  # graph input
code = StringInput("Bridge_SideWalk_Top_Left_Internal")  # graph input
offset = DoubleInput(1)  # graph input
elevation = DoubleInput(2)  # graph input
pipe_length = DoubleInput(12)  # graph input

# group: Get Featurelines By Code
getDocumentByName = CivilConnection.CivilApplication.GetDocumentByName(civilApplication=civilApplication, name=document)
getCorridorByName = CivilConnection.CivilDocument.GetCorridorByName(civilDocument=getDocumentByName, name=corridor)
getFeaturelinesByCode = CivilConnection.Corridor.GetFeaturelinesByCode(corridor=getCorridorByName, code=code)
flatten = List.Flatten(list=getFeaturelinesByCode)

# group: Calculate Pipe Center Lines
getPolyCurveByOffsetElevation = CivilConnection.Featureline.GetPolyCurveByOffsetElevation(featureline=flatten, offset=offset, elevation=elevation)
pointsByChord = CivilConnection.Featureline.PointsByChord(curve=getPolyCurveByOffsetElevation, chord=pipe_length)
byPoints = PolyCurve.ByPoints(points=pointsByChord)
curves = PolyCurve.Curves(polyCurve=byPoints)

# group: Create Pipes
byCurveFeatureline = CivilConnection.MEP.Pipe.ByCurveFeatureline(pipeType=code_block_3, pipingSystemType=code_block.out1, level=levels, curve=curves, featureline=flatten)
flatten_2 = List.Flatten(list=byCurveFeatureline)

# group: Create pairs
# note: Returns a list of pairs (e.g. {{0, 1}, {1, 2}, {2, 3}...} )
code_block_4 = CodeBlock { 0..1; 1; -1; }
sublists = List.Sublists(list=flatten_2, ranges=code_block_4.out0, offset=code_block_4.out1)
dropItems = List.DropItems(list=sublists, amount=code_block_4.out2)

# group: Create Fittings
transpose = List.Transpose(lists=dropItems)
firstItem = List.FirstItem(list=transpose)
lastItem = List.LastItem(list=transpose)
elbow = CivilConnection.MEP.Fitting.Elbow(curve1=firstItem, curve2=lastItem)

# group: Set Diameter
code_block_5 = CodeBlock { "Diameter"; }
setParameterByName = Element.SetParameterByName(element=flatten_2, parameterName=code_block_5)  # unwired: value

# group: Inspect Codes
getCodes = CivilConnection.Corridor.GetCodes(corridor=getCorridorByName)
